# Grasshopper definition VSCode to Grasshopper.gh (Grasshopper 1.0.7)

path = FilePath("C:\Users\abdul\Desktop\NewCode1.py")
path_2 = FilePath("C:\Program Files\Microsoft VS Code\Code.exe")
python = GhPythonScript(RunVSCode=Toggle(False), VSCode=path_2, file=path, CopyCode=Button(ExpressionNormal="True", ExpressionPressed="False"))  # -> out, Code; inputs RunVSCode: Boolean, CopyCode: Boolean
# ---------- python: Python ----------
__author__ = "abdul"
__version__ = "2023.12.06"

import rhinoscriptsyntax as rs
import os
import subprocess

vscode_path = VSCode.replace('\\', '\\\\')
file_path = file.replace('\\', '\\\\')
command = [vscode_path, file_path]
process_name = 'Code'

def save_file(file_path):
    subprocess.Popen([vscode_path, '--command', 'workbench.action.files.save'], shell=True)
    
def run_vscode():
    subprocess.Popen(command, shell=True)
    
def close_vscode():
    save_file(file_path)
    subprocess.Popen(['taskkill', '/F', '/IM', process_name + '.exe'], shell=True)
    
def copy_content(file_path):
    with open(file_path, 'r') as file:
        file_content = file.read()
    return file_content
    
if(RunVSCode):
    if os.path.exists(file):
        run_vscode()
        print("The file is found, opening the file in VSCode succeeded...")
        if(CopyCode):
            content = copy_content(file_path)
            Code = content
            print("File contents are copied from VSCode to Grasshopper Successfully!")
    else:
        command = [vscode_path]
        run_vscode()
        print("The file does not exist, opening VSCode instance without files...")
    

else:
    save_file(file_path)
    close_vscode()
    Code = None
    print("Successfully closed VSCode!");
# ---------- end python ----------
panel = Panel(python.out)
panel_2 = Panel(python.Code)
